# Grasshopper definition GH_python_remote_sticky.ghx (Grasshopper 0.9.76)
# plug-ins: Python Interpreter

# Turn me on!   -->
python = PythonScript()  # -> GH_to_python_sticky_path
# ---------- python: Python ----------
import ghpythonremote
import inspect
from os import path

ROOT = path.abspath(path.dirname(inspect.getfile(ghpythonremote)))
GH_to_python_sticky_path = path.join(ROOT, 'examples', 'GH_to_python_sticky.py')
# ---------- end python ----------
python_2 = PythonScript()  # -> rhino_doc_dir
# ---------- python_2: Python ----------
import scriptcontext as sc
from os import path

rhino_doc_dir = path.abspath(path.dirname(sc.doc.Path))
# ---------- end python_2 ----------
list = ValueList({"CRITICAL", "ERROR", "WARNING", "INFO", "DEBUG", "NOTSET"}, selected="DEBUG")

# ---- group: Import remote python modules
panel = Panel(python_2)
# GH to python remote example.
# Pierre Cuvilliers, 2017
# Released under the MIT license
# github.com/pilcru/ghpythonremote
# Runs and connects to an external python engine, and
# assigns imported modules to scriptcontext.sticky variables.
# 
# Arguments:
#       code (str): Path to the GH_to_python_sticky.py code file.
#       env_name (str): The name of the python virtual
#             environment to use to run the external python engine.
#       run (boolean): Creates the connection, and imports new
#             modules, when turned to True. Kills the connection,
#             and deletes the references to the imports, when turned
#             to False.
#       modules (str list): List of module names to import in the
#             remote python. They will be added to the
#             scriptcontext.sticky dictionnary, allowing them to be
#             reused from other python components in the same
#             Grasshopper document. Submodules (for example
#             `numpy.linalg` have to be added explicitely to this list
#             to be available later.
#       log_level (str from ['NOTSET', 'DEBUG', 'INFO', 'WARNING', 'ERROR', 'CRITICAL']):
#             Logging level to use for the local IronPython and the
#             remote python instance.
#       working_dir (str): Working directory for the remote python
#             instance.
# 
# Returns:
#       out (str): Console output with DEBUG information.
#       linked_modules (str list): list of imported module names.
panel_2 = Panel(python)
panel_3 = Panel("""numpy
scipy
numpy.linalg""")
file = ReadFile(F=panel_2, PerLineParse=False)  # -> C
#   port F: Uri of file to read
# ---------- file: VB line parser ----------
    action = GH_LineParserAction.Include
    Return line

    'Parse the line and return some data that represents the line.
    'If the line cannot be parsed, you can return Nothing and
    'assign a different action.
    'The default implementation is to just return the line itself.
    'If you return types that implement IGH_Goo, this component
    'will work substantially faster.
# ---------- end file ----------
python_3 = PythonScript(Code=file, Env_name="rhinoremote", Run=Toggle(False), Modules=panel_3, Log_level=list, Working_dir=panel)  # -> Out, Linked_modules
panel_4 = Panel(python_3.Out)

# ---- group: Use numpy, double-click to open and run
python_4 = PythonScript()  # -> out, a
# ---------- python_4: Python ----------
import scriptcontext
np = scriptcontext.sticky['numpy']
# Do some stuff
a = np.arange(15).reshape(3, 5)
print(a)
print(np.linalg.eig(np.arange(9).reshape(3, 3)))
# ---------- end python_4 ----------

# ----
panel_5 = Panel(python_4.out)
